# Dynamo graph Apply view sync to revit.dyn (Dynamo 3.3.0.6316)

file_path = Filename(".\latest-switchback.json")
python_script = Python(IN[0]=file_path)  # CPython3
# ---------- python_script.python (673 lines) ----------
# Dynamo Python for Revit
# IN[0] = filepath to latest-switchback.json
#
# Switchback sync:
# - Camera from payload.revitViewport
# - Centre Revit viewport on the camera target point
# - Section box from payload.section.sectionBox if available
# - Converts APS section box points using model.globalOffset
# - If ACC/APS has no section, turns OFF Revit active 3D view section box
#
# Does NOT:
# - Move elements
# - Hide/isolate elements
# - Change element graphics
# - Create a new view
#
# It only changes:
# - Active 3D view orientation
# - Active 3D view viewport zoom/centre
# - Active 3D view section box state

import clr
import json
import os

clr.AddReference("RevitServices")
from RevitServices.Persistence import DocumentManager
from RevitServices.Transactions import TransactionManager

clr.AddReference("RevitAPI")
from Autodesk.Revit.DB import (
    XYZ,
    View3D,
    ViewOrientation3D,
    BoundingBoxXYZ,
    Transform
)

doc = DocumentManager.Instance.CurrentDBDocument
uiapp = DocumentManager.Instance.CurrentUIApplication
uidoc = uiapp.ActiveUIDocument

file_path = IN[0]

TURN_OFF_REVIT_SECTION_WHEN_ACC_HAS_NO_SECTION = True
MIN_SECTION_SIZE = 0.10

# If APS orthographicHeight is too large/small compared with Revit UI,
# adjust this slightly, e.g. 0.8 or 1.2.
ZOOM_SCALE = 1.0


def safe_get(data, key, default=None):
    if isinstance(data, dict):
        value = data.get(key, default)
        if value is None:
            return default
        return value
    return default


def get_nested(data, keys):
    current = data

    for key in keys:
        if current is None:
            return None

        if isinstance(current, dict):
            current = current.get(key)
        else:
            return None

    return current


def read_json(path):
    if not path:
        raise Exception("IN[0] is empty. Please provide the full JSON filepath.")

    path = str(path)

    if not os.path.exists(path):
        raise Exception("JSON file not found: {}".format(path))

    with open(path, "r") as f:
        return json.load(f)


def to_xyz(value):
    if value is None:
        return None

    if isinstance(value, list) and len(value) >= 3:
        return XYZ(float(value[0]), float(value[1]), float(value[2]))

    if isinstance(value, dict):
        x = value.get("x", value.get("X", None))
        y = value.get("y", value.get("Y", None))
        z = value.get("z", value.get("Z", None))

        if x is not None and y is not None and z is not None:
            return XYZ(float(x), float(y), float(z))

    return None


def xyz_to_list(point):
    if point is None:
        return None

    return [point.X, point.Y, point.Z]


def add_xyz(a, b):
    return XYZ(a.X + b.X, a.Y + b.Y, a.Z + b.Z)


def subtract_xyz(a, b):
    return XYZ(a.X - b.X, a.Y - b.Y, a.Z - b.Z)


def multiply_xyz(vector, scalar):
    return XYZ(vector.X * scalar, vector.Y * scalar, vector.Z * scalar)


def safe_normalize(vector, fallback):
    if vector is None:
        return fallback

    length = vector.GetLength()

    if length < 0.000001:
        return fallback

    return vector.Normalize()


def get_any_perpendicular_vector(forward):
    z_axis = XYZ(0, 0, 1)
    y_axis = XYZ(0, 1, 0)
    x_axis = XYZ(1, 0, 0)

    if abs(forward.DotProduct(z_axis)) < 0.90:
        candidate = z_axis
    elif abs(forward.DotProduct(y_axis)) < 0.90:
        candidate = y_axis
    else:
        candidate = x_axis

    projection_length = candidate.DotProduct(forward)
    projection = multiply_xyz(forward, projection_length)
    perpendicular = subtract_xyz(candidate, projection)

    return safe_normalize(perpendicular, XYZ(0, 0, 1))


def make_up_perpendicular_to_forward(up, forward):
    forward = safe_normalize(forward, XYZ(0, 0, -1))

    if up is None:
        return get_any_perpendicular_vector(forward)

    up = safe_normalize(up, XYZ(0, 0, 1))

    dot = up.DotProduct(forward)
    projection = multiply_xyz(forward, dot)
    up_perp = subtract_xyz(up, projection)

    if up_perp.GetLength() < 0.000001:
        up_perp = get_any_perpendicular_vector(forward)

    up_perp = safe_normalize(up_perp, get_any_perpendicular_vector(forward))

    final_dot = abs(up_perp.DotProduct(forward))

    if final_dot > 0.0001:
        up_perp = get_any_perpendicular_vector(forward)

    return up_perp


def get_active_3d_view():
    active_view = doc.ActiveView

    if not isinstance(active_view, View3D):
        return None, "Active view is not a 3D view. Current active view: {}".format(active_view.Name)

    if active_view.IsTemplate:
        return None, "Active view is a 3D view template, not an editable 3D view: {}".format(active_view.Name)

    return active_view, None


def unlock_3d_view_if_needed(view3d):
    try:
        if hasattr(view3d, "IsLocked") and view3d.IsLocked:
            view3d.Unlock()
            return True
    except:
        pass

    return False


def get_global_offset(payload):
    offset = get_nested(payload, ["model", "globalOffset"])
    xyz = to_xyz(offset)

    if xyz:
        return xyz

    return XYZ(0, 0, 0)


def get_revit_viewport_camera(payload):
    schema_version = safe_get(payload, "schemaVersion", None)
    revit_viewport = safe_get(payload, "revitViewport", None)

    if schema_version != "2.0":
        raise Exception("Wrong or old switchback JSON. Expected schemaVersion 2.0, got: {}.".format(schema_version))

    if not isinstance(revit_viewport, dict):
        raise Exception("This JSON does not contain revitViewport.")

    eye = to_xyz(safe_get(revit_viewport, "eye"))
    target = to_xyz(safe_get(revit_viewport, "target"))
    up = to_xyz(safe_get(revit_viewport, "up"))

    if eye is None or target is None:
        raise Exception("revitViewport does not contain valid eye and target values.")

    return {
        "source": "revitViewport",
        "eye": eye,
        "target": target,
        "up": up,
        "projection": safe_get(revit_viewport, "projection"),
        "isOrthographic": safe_get(revit_viewport, "isOrthographic"),
        "orthographicHeight": safe_get(revit_viewport, "orthographicHeight"),
        "distanceToOrbit": safe_get(revit_viewport, "distanceToOrbit"),
        "aspectRatio": safe_get(revit_viewport, "aspectRatio"),
        "rawApsEye": safe_get(revit_viewport, "rawApsEye"),
        "rawApsTarget": safe_get(revit_viewport, "rawApsTarget")
    }


def apply_camera_to_active_view(view3d, camera_data):
    eye = camera_data["eye"]
    target = camera_data["target"]
    up = camera_data["up"]

    forward = target.Subtract(eye)
    forward = safe_normalize(forward, XYZ(0, 0, -1))

    up_vector = make_up_perpendicular_to_forward(up, forward)

    orientation = ViewOrientation3D(eye, up_vector, forward)

    was_unlocked = unlock_3d_view_if_needed(view3d)

    view3d.SetOrientation(orientation)

    return {
        "sourceUsed": camera_data["source"],
        "eye": xyz_to_list(eye),
        "target": xyz_to_list(target),
        "upOriginal": xyz_to_list(up),
        "upCorrected": xyz_to_list(up_vector),
        "forward": xyz_to_list(forward),
        "dotUpForward": up_vector.DotProduct(forward),
        "projectionFromJson": camera_data.get("projection"),
        "isOrthographicFromJson": camera_data.get("isOrthographic"),
        "orthographicHeightFromJson": camera_data.get("orthographicHeight"),
        "distanceToOrbitFromJson": camera_data.get("distanceToOrbit"),
        "wasUnlocked": was_unlocked,
        "upVectorUsed": up_vector,
        "forwardVectorUsed": forward
    }


def get_active_ui_view(view_id):
    try:
        ui_views = uidoc.GetOpenUIViews()

        for ui_view in ui_views:
            if ui_view.ViewId.IntegerValue == view_id.IntegerValue:
                return ui_view
    except:
        pass

    return None


def center_view_on_target(view3d, camera_data, camera_result):
    ui_view = get_active_ui_view(view3d.Id)

    if ui_view is None:
        return {
            "applied": False,
            "reason": "Could not find active UIView for ZoomAndCenterRectangle."
        }

    target = camera_data["target"]
    up_vector = camera_result.get("upVectorUsed")
    forward = camera_result.get("forwardVectorUsed")

    if target is None or up_vector is None or forward is None:
        return {
            "applied": False,
            "reason": "Missing target/up/forward for centering."
        }

    # Right vector on screen. This is perpendicular to view direction and view up.
    right = forward.CrossProduct(up_vector)
    right = safe_normalize(right, XYZ(1, 0, 0))

    up_vector = safe_normalize(up_vector, XYZ(0, 0, 1))

    orthographic_height = camera_data.get("orthographicHeight")
    aspect_ratio = camera_data.get("aspectRatio")

    try:
        orthographic_height = float(orthographic_height)
    except:
        orthographic_height = None

    try:
        aspect_ratio = float(aspect_ratio)
    except:
        aspect_ratio = None

    if orthographic_height is None or orthographic_height <= 0:
        distance_to_orbit = camera_data.get("distanceToOrbit")
        try:
            distance_to_orbit = float(distance_to_orbit)
        except:
            distance_to_orbit = 100.0

        orthographic_height = max(distance_to_orbit, 10.0)

    if aspect_ratio is None or aspect_ratio <= 0:
        aspect_ratio = 1.3333333333

    half_height = (orthographic_height * ZOOM_SCALE) / 2.0
    half_width = half_height * aspect_ratio

    bottom_left = target \
        .Subtract(multiply_xyz(right, half_width)) \
        .Subtract(multiply_xyz(up_vector, half_height))

    top_right = target \
        .Add(multiply_xyz(right, half_width)) \
        .Add(multiply_xyz(up_vector, half_height))

    try:
        ui_view.ZoomAndCenterRectangle(bottom_left, top_right)

        return {
            "applied": True,
            "method": "UIView.ZoomAndCenterRectangle",
            "centerTarget": xyz_to_list(target),
            "bottomLeft": xyz_to_list(bottom_left),
            "topRight": xyz_to_list(top_right),
            "orthographicHeight": orthographic_height,
            "aspectRatio": aspect_ratio,
            "zoomScale": ZOOM_SCALE
        }
    except Exception as ex:
        return {
            "applied": False,
            "reason": str(ex),
            "centerTarget": xyz_to_list(target)
        }


def make_8_corners(min_point, max_point):
    return [
        XYZ(min_point.X, min_point.Y, min_point.Z),
        XYZ(min_point.X, min_point.Y, max_point.Z),
        XYZ(min_point.X, max_point.Y, min_point.Z),
        XYZ(min_point.X, max_point.Y, max_point.Z),
        XYZ(max_point.X, min_point.Y, min_point.Z),
        XYZ(max_point.X, min_point.Y, max_point.Z),
        XYZ(max_point.X, max_point.Y, min_point.Z),
        XYZ(max_point.X, max_point.Y, max_point.Z)
    ]


def make_axis_aligned_box_from_points(points):
    if not points:
        return None

    min_x = min(p.X for p in points)
    min_y = min(p.Y for p in points)
    min_z = min(p.Z for p in points)

    max_x = max(p.X for p in points)
    max_y = max(p.Y for p in points)
    max_z = max(p.Z for p in points)

    if abs(max_x - min_x) < MIN_SECTION_SIZE:
        max_x = min_x + MIN_SECTION_SIZE

    if abs(max_y - min_y) < MIN_SECTION_SIZE:
        max_y = min_y + MIN_SECTION_SIZE

    if abs(max_z - min_z) < MIN_SECTION_SIZE:
        max_z = min_z + MIN_SECTION_SIZE

    box = BoundingBoxXYZ()
    box.Transform = Transform.Identity
    box.Min = XYZ(min_x, min_y, min_z)
    box.Max = XYZ(max_x, max_y, max_z)

    return box


def plane_to_values(plane):
    if isinstance(plane, list) and len(plane) >= 4:
        return [float(plane[0]), float(plane[1]), float(plane[2]), float(plane[3])]

    if isinstance(plane, dict):
        x = plane.get("x", plane.get("X", None))
        y = plane.get("y", plane.get("Y", None))
        z = plane.get("z", plane.get("Z", None))
        w = plane.get("w", plane.get("W", None))

        if x is not None and y is not None and z is not None and w is not None:
            return [float(x), float(y), float(z), float(w)]

    return None


def try_axis_aligned_box_from_cutplanes(cutplanes):
    min_x = None
    max_x = None
    min_y = None
    max_y = None
    min_z = None
    max_z = None

    for plane in cutplanes:
        values = plane_to_values(plane)

        if not values:
            continue

        a, b, c, d = values

        if abs(a - 1.0) < 0.0001 and abs(b) < 0.0001 and abs(c) < 0.0001:
            min_x = -d

        elif abs(a + 1.0) < 0.0001 and abs(b) < 0.0001 and abs(c) < 0.0001:
            max_x = d

        elif abs(b - 1.0) < 0.0001 and abs(a) < 0.0001 and abs(c) < 0.0001:
            min_y = -d

        elif abs(b + 1.0) < 0.0001 and abs(a) < 0.0001 and abs(c) < 0.0001:
            max_y = d

        elif abs(c - 1.0) < 0.0001 and abs(a) < 0.0001 and abs(b) < 0.0001:
            min_z = -d

        elif abs(c + 1.0) < 0.0001 and abs(a) < 0.0001 and abs(b) < 0.0001:
            max_z = d

    if min_x is None or max_x is None or min_y is None or max_y is None or min_z is None or max_z is None:
        return None

    return {
        "min": XYZ(min_x, min_y, min_z),
        "max": XYZ(max_x, max_y, max_z)
    }


def get_section_box_data(payload):
    section = safe_get(payload, "section", {})
    global_offset = get_global_offset(payload)

    if not isinstance(section, dict):
        return {
            "hasSection": False,
            "source": "none",
            "reason": "section object missing or invalid"
        }

    has_section = bool(safe_get(section, "hasSection", False))

    if not has_section:
        return {
            "hasSection": False,
            "source": "section.hasSection=false",
            "reason": "ACC viewer had no active section/cut data"
        }

    section_box = safe_get(section, "sectionBox", None)

    if isinstance(section_box, dict):
        aps_min = to_xyz(safe_get(section_box, "min"))
        aps_max = to_xyz(safe_get(section_box, "max"))

        if aps_min is not None and aps_max is not None:
            aps_corners = make_8_corners(aps_min, aps_max)
            revit_corners = [add_xyz(corner, global_offset) for corner in aps_corners]
            revit_box = make_axis_aligned_box_from_points(revit_corners)

            return {
                "hasSection": True,
                "source": "section.sectionBox + model.globalOffset",
                "box": revit_box,
                "apsMin": aps_min,
                "apsMax": aps_max,
                "revitMin": revit_box.Min if revit_box else None,
                "revitMax": revit_box.Max if revit_box else None
            }

    cutplanes = safe_get(section, "cutPlanes", [])

    if isinstance(cutplanes, list) and len(cutplanes) >= 6:
        axis_box = try_axis_aligned_box_from_cutplanes(cutplanes)

        if axis_box:
            aps_corners = make_8_corners(axis_box["min"], axis_box["max"])
            revit_corners = [add_xyz(corner, global_offset) for corner in aps_corners]
            revit_box = make_axis_aligned_box_from_points(revit_corners)

            return {
                "hasSection": True,
                "source": "section.cutPlanes-axis-aligned + model.globalOffset",
                "box": revit_box,
                "apsMin": axis_box["min"],
                "apsMax": axis_box["max"],
                "revitMin": revit_box.Min if revit_box else None,
                "revitMax": revit_box.Max if revit_box else None,
                "cutPlaneCount": len(cutplanes)
            }

        return {
            "hasSection": True,
            "unsupported": True,
            "source": "section.cutPlanes",
            "reason": "Cut planes exist, but they are not an axis-aligned box that can safely become Revit BoundingBoxXYZ.",
            "cutPlaneCount": len(cutplanes)
        }

    return {
        "hasSection": True,
        "unsupported": True,
        "source": "section.hasSection=true",
        "reason": "section.hasSection is true, but no sectionBox or usable cutPlanes were found."
    }


def apply_section_to_active_view(view3d, section_data):
    if not section_data.get("hasSection", False):
        if TURN_OFF_REVIT_SECTION_WHEN_ACC_HAS_NO_SECTION:
            view3d.IsSectionBoxActive = False

            return {
                "applied": True,
                "sectionBoxActive": False,
                "source": section_data.get("source"),
                "message": "ACC had no section. Revit section box switched off."
            }

        return {
            "applied": False,
            "sectionBoxActive": view3d.IsSectionBoxActive,
            "source": section_data.get("source"),
            "message": "ACC had no section. Revit section box left unchanged."
        }

    if section_data.get("unsupported", False):
        return {
            "applied": False,
            "sectionBoxActive": view3d.IsSectionBoxActive,
            "source": section_data.get("source"),
            "reason": section_data.get("reason"),
            "cutPlaneCount": section_data.get("cutPlaneCount")
        }

    box = section_data.get("box")

    if box is None:
        return {
            "applied": False,
            "sectionBoxActive": view3d.IsSectionBoxActive,
            "reason": "Section data existed but no Revit box could be built."
        }

    view3d.IsSectionBoxActive = True
    view3d.SetSectionBox(box)

    return {
        "applied": True,
        "sectionBoxActive": True,
        "source": section_data.get("source"),
        "apsMin": xyz_to_list(section_data.get("apsMin")),
        "apsMax": xyz_to_list(section_data.get("apsMax")),
        "revitBoxMin": xyz_to_list(box.Min),
        "revitBoxMax": xyz_to_list(box.Max)
    }


try:
    payload = read_json(file_path)

    if not isinstance(payload, dict):
        raise Exception("The JSON root is not an object/dictionary.")

    active_view, warning = get_active_3d_view()

    if warning:
        OUT = {
            "success": False,
            "warning": warning,
            "message": "Switchback was not applied. Please make a 3D view active and run again.",
            "jsonFile": file_path
        }
    else:
        camera_data = get_revit_viewport_camera(payload)
        section_data = get_section_box_data(payload)

        TransactionManager.Instance.EnsureInTransaction(doc)

        camera_result = apply_camera_to_active_view(active_view, camera_data)
        section_result = apply_section_to_active_view(active_view, section_data)

        TransactionManager.Instance.TransactionTaskDone()

        # Centre the target point on screen after the camera and section box are applied.
        center_result = center_view_on_target(active_view, camera_data, camera_result)

        try:
            uidoc.RefreshActiveView()
        except:
            pass

        # Remove non-serialisable XYZ objects from camera_result before OUT.
        if "upVectorUsed" in camera_result:
            camera_result.pop("upVectorUsed")

        if "forwardVectorUsed" in camera_result:
            camera_result.pop("forwardVectorUsed")

        OUT = {
            "success": True,
            "message": "Switchback applied. Camera synced, target centred, and Revit section box matches ACC section state.",
            "jsonFile": file_path,
            "schemaVersion": safe_get(payload, "schemaVersion"),
            "viewName": active_view.Name,
            "activeViewId": active_view.Id.IntegerValue,
            "cameraApplied": camera_result,
            "centerApplied": center_result,
            "sectionApplied": section_result,
            "elementsMoved": False,
            "graphicsChanged": False,
            "visibilityChanged": False
        }

except Exception as ex:
    try:
        TransactionManager.Instance.ForceCloseTransaction()
    except:
        pass

    OUT = {
        "success": False,
        "message": str(ex),
        "jsonFile": file_path
    }
# ----------------------------------------
watch = Watch(python_script)
